# Grasshopper definition showcase.gh (Grasshopper 1.0.8)
# plug-ins: Conduit+

# ---- group: 1 Room data (Demo Rooms) · metres, fictitious minima
plan_scale = Slider(1, range=0.5..2)
rooms = DemoRooms(PlanScale=plan_scale)  # -> Rooms, Keys, Names, AreaDelta, Rows, GIA, NetToGross, Circulation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

# ---- group: 4 Truss data (Demo Truss) · illustrative, not analysis
span_m = Slider(24, range=12..36)
load_kn_m = Slider(12, range=0..24)
truss = DemoTruss(Span=span_m, Bays=6, Depth=3, Load=load_kn_m)  # -> Members, Keys, Labels, Utilisation, Deflection, Mass, Rows, MaxUtilisation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

# ---- group: 7 Massing (Demo Massing) · grouped Bar, Key Legend, Metric on canvas
extra_floors = Slider(0, range=-1..5)
massing = DemoMassing(ExtraFloors=extra_floors)  # -> Blocks, Keys, HeightRatios, Rows, GFA, AllowedGFA, FAR, Uses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
bar = Bar(
    Values=massing.GFAByUse,
    Labels=massing.Uses,
    Keys=massing.UseKeys,
    Title="GFA by use (m²)",
    Threshold=16000,
    Colors=massing.UseColors,
    Members=massing.UseMembers)
metric = Metric(Value=massing.FAR, Title="FAR (allowed 2.0)", Decimals=2)
keylegend = KeyLegend(Keys=massing.Uses, Colors=massing.UseColors, Title="Uses")
canvas_card = CanvasCard(Card=bar, ConduitPlus_CanvasTheme="Auto")
canvas_card_2 = CanvasCard(Card=keylegend, ConduitPlus_CanvasTheme="Auto")
canvas_card_3 = CanvasCard(Card=metric, ConduitPlus_CanvasTheme="Auto")

# ---- group: 2 Viewport cards · Title, Metric ×3, Bar, Table, Legend ×2, Line, Key Legend, Text
area_min = Slider(0, range=0..0)
area_max = Slider(40, range=40..40)
legend = Legend(
    Colors=rooms.TypeColors,
    Labels=rooms.Types,
    Keys=rooms.TypeKeys,
    Title="Room types",
    Slot="tr",
    Members=rooms.TypeMembers)
legend_2 = Legend(
    Colors=[RGB(44, 123, 182), RGB(255, 255, 191), RGB(215, 25, 28)],
    Min=area_min,
    Max=area_max,
    Unit="m²",
    Title="Room area",
    Slot="br")
bar_2 = Bar(
    Values=rooms.AreaDelta,
    Labels=rooms.Names,
    Keys=rooms.Keys,
    Title="Area − minimum (m²)",
    Threshold=0,
    Slot="tl",
    Colors=rooms.StatusColors)
line = Line(Values=rooms.Areas, Labels=rooms.Names, Keys=rooms.Keys, Title="Area per room (m²)", Threshold=12, Slot="bl")
metric_2 = Metric(Value=rooms.GIA, Title="Schematic GIA", Unit="m²", Slot="tl", Decimals=0)
metric_3 = Metric(Value=rooms.NetToGross, Title="Net / gross", Unit="%", Slot="tl", Decimals=1)
metric_4 = Metric(
    Value=rooms.FailingRooms,
    Title="Rooms below minimum",
    Slot="tl",
    Decimals=0,
    Key="below-minimum",
    Members=rooms.FailingMembers)
table = Table(
    Headers=["Room", "Type", "m²", "Min m²", "Δ m²", "Status"],
    Rows=rooms.Rows,
    Keys=rooms.Keys,
    Title="Room schedule",
    Slot="tr",
    VisibleRows=6,
    Width=520)
text = Text(
    Title="How to read this",
    Text="""Bars show area minus the type minimum; red is a deficit.
Shift adds to the selection, Ctrl removes; Clear or an empty click resets.
Demo data: not a regulatory check.""",
    Width=280,
    Slot="bl")
title = Title(
    Title="Conduit+ showcase",
    Subtitle="Room area check · 17 rooms",
    Description="""Every card kind on one viewport.
Click a room, row, bar or swatch.""",
    Position="tc")
keylegend_2 = KeyLegend(
    Keys=["Meets minimum", "Below minimum"],
    Colors=[RGB(31, 138, 91), RGB(194, 51, 77)],
    Values=["9 rooms", "8 rooms"],
    Title="Status",
    Slot="br")

# ---- group: 5 Same card kinds on the GH canvas · one Canvas Card each
scale_min = Slider(0, range=0..0)
scale_max = Slider(1.2, range=1.2..1.2)
legend_3 = Legend(
    Colors=[RGB(31, 138, 91), RGB(229, 182, 61), RGB(194, 51, 77)],
    Min=scale_min,
    Max=scale_max,
    Unit="ratio",
    Title="Utilisation scale")
bar_3 = Bar(Values=truss.Utilisation, Labels=truss.Labels, Keys=truss.Keys, Title="Member utilisation", Threshold=1)
line_2 = Line(Values=truss.Deflection, Labels=truss.Stations, Title="Deflection along span (mm)")
metric_5 = Metric(Value=truss.MaxUtilisation, Title="Max utilisation", Unit="ratio", Decimals=2)
table_2 = Table(
    Headers=["Member", "Type", "Util.", "Length (m)"],
    Rows=truss.Rows,
    Keys=truss.Keys,
    Title="Member results",
    VisibleRows=8,
    Width=380)
text_2 = Text(
    Title="Assumptions",
    Text="""Pin supports at both ends.
Uniform load on the top chord.
Illustrative numbers only.""",
    Width=240)
title_2 = Title(Title="Truss review", Subtitle="6 bays", Background="Card")

# ---- group: 6 Canvas Cards (unscoped: private selection)
canvas_card_4 = CanvasCard(Card=metric_5, ConduitPlus_CanvasTheme="Auto")
canvas_card_5 = CanvasCard(Card=bar_3, ConduitPlus_CanvasTheme="Auto")
canvas_card_6 = CanvasCard(Card=line_2, ConduitPlus_CanvasTheme="Auto")
canvas_card_7 = CanvasCard(Card=table_2, ConduitPlus_CanvasTheme="Auto")
canvas_card_8 = CanvasCard(Card=legend_3, ConduitPlus_CanvasTheme="Auto")
canvas_card_9 = CanvasCard(Card=title_2, ConduitPlus_CanvasTheme="Auto")
canvas_card_10 = CanvasCard(Card=text_2, ConduitPlus_CanvasTheme="Auto")

# ---- group: 3 Link geometry → Overlay · Scope shares selection with a Canvas Card
link = Link(Geometry=rooms.Rooms, Keys=flatten(rooms.Keys))
scope = Scope(Name="Room review")
overlay = Overlay(
    Cards=flatten([title, metric_2, metric_3, metric_4, bar_2, table, legend, legend_2, line, keylegend_2, text]),
    Links=flatten(link),
    Scope=scope,
    Size=1,
    ConduitPlus_Theme="Auto")  # -> Selection, Events
canvas_card_11 = CanvasCard(Card=table, Scope=scope, ConduitPlus_CanvasTheme="Auto")
selection = Panel(overlay.Selection)
